# Dynamo graph Revision Cloud Data to Excel.dyn (Dynamo 2.0.3.8810)

# note: Revision Cloud Data to Excel
# Version 0.6.2
# Coded by Andrew King
# http://andrewkingme.com
# 2016-02-06 Version 0.1
# Hello World
# 2016-02-08 Version 0.2
# Output matchingrevisionclouds from Python node to avoid hidden element mismatch.
# 2016-02-09 Version 0.3
# Added Revit Element ID and View ID output.
# 2016-02-14 Version 0.4
# Expanded Python code to output every instance of a revision cloud in every instance of a legend.
# Filtered dependent views to only show instances on sheets.
# 2016-02-16 Version 0.5
# Restructured code to reduce number of cycles.
# Eliminated the need for a separate legend/dependency path.
# Boolean selector for Revisions on Sheets/Revisions in Views on Sheets.
# Revit 2014 compatibility.
# 2016-02-25 Version 0.6
# Added category filter to improve FilteredElementCollector performace.
# Replaced List.Combine with List.AddItemToFront
# Added Sorting
# 2016-03-30 Version 0.6.1
# Revised Excel headers.
# 2020-03-09 Version 0.6.2
# Added owner information.

# group: Change Path Before Running
file_path = Filename("..\..\..\..\Desktop\output")  # graph input

code_block = CodeBlock { "Revision Data"; 0; 0; true; }
code_block_2 = CodeBlock()
# ---------- code_block_2.designscript (11 lines) ----------
"Sheet Number";
"Sheet Name";
"Revision Number";
"Revision Description";
"Revision Date";
"Mark";
"Comments";
"Revision Cloud ID";
"View ID";
"Created by";
"Last Update in central by";
# ----------------------------------------
create = List.Create(item0=code_block_2.out0, item1=code_block_2.out1, item2=code_block_2.out2, item3=code_block_2.out3, item4=code_block_2.out4, item5=code_block_2.out5, item6=code_block_2.out6, item7=code_block_2.out7, item8=code_block_2.out8, item9=code_block_2.out9, item10=code_block_2.out10)
categories = Categories(index=404)  # graph input
all_elements_of_category = ElementsOfCategory(Category=categories)
watch = Watch(all_elements_of_category)
categories_2 = Categories(index=447)  # graph input
all_elements_of_category_2 = ElementsOfCategory(Category=categories_2)
watch_2 = Watch(all_elements_of_category_2)
revisions_on_sheets = BoolSelector(true)  # graph input
revisions_in_views_on_sheets = BoolSelector(true)  # graph input
python_script = Python(IN[0]=watch, IN[1]=watch_2, IN[2]=revisions_on_sheets, IN[3]=revisions_in_views_on_sheets)
# ---------- python_script.python (66 lines) ----------
# Python Node for Dynamo
# Input: Revision Clouds, Sheets
# Output: Matching Sheets, Matching Revision Clouds, Referencing Views
# Coded by Andrew King
# https://andrewkingme.com

import clr
clr.AddReference('ProtoGeometry')
from Autodesk.DesignScript.Geometry import *

# Import RevitAPI
clr.AddReference('RevitAPI')
import Autodesk
from Autodesk.Revit.DB import *

# Import DocumentManager and TransactionManager
clr.AddReference('RevitServices')
import RevitServices
from RevitServices.Persistence import DocumentManager
from RevitServices.Transactions import TransactionManager

#Assign input to the IN variables.
revisioncloudinput = UnwrapElement(IN[0])
sheetinput = UnwrapElement(IN[1])
revisionsonsheets = IN[2]
revisionsinviewsonsheets = IN[3]

matchingsheets = []
matchingrevisionclouds = []
matchingviews = []

#Look for revision clouds on sheets.
if revisionsonsheets == True:
	for sheet in sheetinput:
		for sheetelement in FilteredElementCollector(DocumentManager.Instance.CurrentDBDocument, sheet.Id).OfCategory(BuiltInCategory.OST_RevisionClouds):
			for revisioncloud in revisioncloudinput:
				if sheetelement.Id == revisioncloud.Id:
					matchingsheets.append(sheet)
					matchingrevisionclouds.append(revisioncloud)
					matchingviews.append(sheet)

#Look for revision clouds in views on sheets.
if revisionsinviewsonsheets == True:
	for sheet in sheetinput:
		if DocumentManager.Instance.CurrentUIApplication.Application.VersionName == "Autodesk Revit 2014":
			for viewport in sheet.GetAllViewports():
				for view in [DocumentManager.Instance.CurrentDBDocument.GetElement(viewport)]:
					for viewid in [DocumentManager.Instance.CurrentDBDocument.GetElement(view.ViewId)]:
						for viewelement in FilteredElementCollector(DocumentManager.Instance.CurrentDBDocument, viewid.Id).OfCategory(BuiltInCategory.OST_RevisionClouds):
							for revisioncloud in revisioncloudinput:
								if viewelement.Id == revisioncloud.Id:
									matchingsheets.append(sheet)
									matchingrevisionclouds.append(revisioncloud)
									matchingviews.append(viewid)
		else:
			for viewport in sheet.GetAllPlacedViews():
				for view in [DocumentManager.Instance.CurrentDBDocument.GetElement(viewport)]:
					for viewelement in FilteredElementCollector(DocumentManager.Instance.CurrentDBDocument, view.Id).OfCategory(BuiltInCategory.OST_RevisionClouds):
						for revisioncloud in revisioncloudinput:
							if viewelement.Id == revisioncloud.Id:
								matchingsheets.append(sheet)
								matchingrevisionclouds.append(revisioncloud)
								matchingviews.append(view)

#Assign output to the OUT variable.
OUT = matchingsheets, matchingrevisionclouds, matchingviews
# ----------------------------------------
code_block_3 = CodeBlock { 0; 1; 2; }

# group: Associated Sheet
getItemAtIndex = List.GetItemAtIndex(list=python_script, index=code_block_3.out0)

watch_3 = Watch(getItemAtIndex)
code_block_4 = CodeBlock { "Sheet Number"; "Sheet Name"; "Revision Number"; "Revision Description"; "Revision Date"; "Mark"; "Comments"; }
getParameterValueByName = Element.GetParameterValueByName(element=watch_3, parameterName=code_block_4.out0)
getParameterValueByName_2 = Element.GetParameterValueByName(element=watch_3, parameterName=code_block_4.out1)

# group: Revision Cloud
getItemAtIndex_2 = List.GetItemAtIndex(list=python_script, index=code_block_3.out1)

watch_4 = Watch(getItemAtIndex_2)
getParameterValueByName_3 = Element.GetParameterValueByName(element=watch_4, parameterName=code_block_4.out2)
getParameterValueByName_4 = Element.GetParameterValueByName(element=watch_4, parameterName=code_block_4.out3)
getParameterValueByName_5 = Element.GetParameterValueByName(element=watch_4, parameterName=code_block_4.out4)
getParameterValueByName_6 = Element.GetParameterValueByName(element=watch_4, parameterName=code_block_4.out5)
getParameterValueByName_7 = Element.GetParameterValueByName(element=watch_4, parameterName=code_block_4.out6)
id = Element.Id(element=watch_4)

# group: Associated View
getItemAtIndex_3 = List.GetItemAtIndex(list=python_script, index=code_block_3.out2)

watch_5 = Watch(getItemAtIndex_3)
id_2 = Element.Id(element=watch_5)
python_script_created_by = Python(IN[0]=watch_4)
# ---------- python_script_created_by.python (23 lines) ----------
# Python Node for Dynamo
# Input: Elements
# Output: Created by
# Coded by Andrew King
# https://andrewkingme.com

import clr
clr.AddReference('RevitAPI')
import Autodesk
from Autodesk.Revit.DB import *

clr.AddReference('RevitServices')
import RevitServices
from RevitServices.Persistence import DocumentManager
from RevitServices.Transactions import TransactionManager

input = UnwrapElement(IN[0])
creator = []

for i in input:
	creator.append(WorksharingUtils.GetWorksharingTooltipInfo(DocumentManager.Instance.CurrentDBDocument, i.Id).Creator)

OUT = creator
# ----------------------------------------
python_script_last_update_in = Python(IN[0]=watch_4)  # "Python Script: Last Update in central by"
# ---------- python_script_last_update_in.python (23 lines) ----------
# Python Node for Dynamo
# Input: Elements
# Output: Last Update in central by
# Coded by Andrew King
# https://andrewkingme.com

import clr
clr.AddReference('RevitAPI')
import Autodesk
from Autodesk.Revit.DB import *

clr.AddReference('RevitServices')
import RevitServices
from RevitServices.Persistence import DocumentManager
from RevitServices.Transactions import TransactionManager

input = UnwrapElement(IN[0])
lastChangedBy = []

for i in input:
	lastChangedBy.append(WorksharingUtils.GetWorksharingTooltipInfo(DocumentManager.Instance.CurrentDBDocument, i.Id).LastChangedBy)

OUT = lastChangedBy
# ----------------------------------------
create_2 = List.Create(item0=getParameterValueByName, item1=getParameterValueByName_2, item2=getParameterValueByName_3, item3=getParameterValueByName_4, item4=getParameterValueByName_5, item5=getParameterValueByName_6, item6=getParameterValueByName_7, item7=id, item8=id_2, item9=python_script_created_by, item10=python_script_last_update_in)
transpose = List.Transpose(lists=create_2)
sortByKey = List.SortByKey(list=transpose, keys=getParameterValueByName)
addItemToFront = List.AddItemToFront(item=create, list=sortByKey.sorted_list)
watch_6 = Watch(addItemToFront)
exportExcel = Data.ExportExcel(filePath=file_path, sheetName=code_block.out0, startRow=code_block.out1, startCol=code_block.out2, data=watch_6, overWrite=code_block.out3)
